# Dynamo graph GrabBIMData.dyn (Dynamo 3.3.0.6316)

code_block = CodeBlock { "46715b0b-8873-4983-82ab-811269331363"; }
code_block_2 = CodeBlock()
# ---------- code_block_2.designscript (1 lines) ----------
"Bearer eyJhbGciOiJSUzI1NiIsInR5cCI6IkpXVCIsImtpZCI6Ik5qWTFSRVUyTXpNeE9EQTVOek5EUkRaRU5rSXlRVUpGTnpRNE5EbEJORFU0UVVGRFJEUkZRdyJ9.eyJodHRwczovL29wZXJhdGlvbnMuaW50ZXJheG8uY29tL3JvbGVzIjpbIkludGVyYXhvIE9wZXJhdGlvbnMgU3VwZXIgVXNlciJdLCJodHRwczovL2ludGVyYXhvLmNvbS91aWQiOiJ2aWt0b3IuZnJ5a2x1bmR-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.CqJV58LEAbi_464a7fr89ErLFwVTLvA8cuRmCwYPvU-bLF30E3n2cMwtugRIRNtVojh9SuJI8bqTuSPR2UqD52Q3qvWYAFoeY06wdf7Mm1pBRPgjr9T7p-yhp6ouPa5zaeeexc4gmmekd0FYRvzKUMJLkn9AM-VGYDY-LUM2ziPHbsjkXhWVyigYHzQFIq1d3gKPKlZXZbXYp6GmB9BpH6rEbOL3t-t3xWzDoZwYD50Sg9-NnbfOS49NUJfFC-6QvZ3H3F47yP4wYCEYypF2rnswX5yt4WvDyD14fUDbx56kdL-2yYbcPCouVGMbUeGFFzQb7gFlTg5UaAyJLyWEKQ";
# ----------------------------------------
all_elements_in_active_view = ElementsInView()
python_script = Python(IN[0]=code_block, IN[1]=code_block_2, IN[9]=all_elements_in_active_view)  # CPython3; unwired: IN[2], IN[3], IN[4], IN[5], IN[6], IN[7], IN[8]
# ---------- python_script.python (229 lines) ----------
import sys
import clr
clr.AddReference('ProtoGeometry')
from Autodesk.DesignScript.Geometry import *

import json
import ssl
import urllib.request
import urllib.error

projectGuid = IN[0]
access_token = IN[1]
typeId = IN[2] if len(IN) > 2 and IN[2] is not None else 100

categories = IN[3] if len(IN) > 3 and IN[3] is not None else []
models = IN[4] if len(IN) > 4 and IN[4] is not None else []
states = IN[5] if len(IN) > 5 and IN[5] is not None else []
levels = IN[6] if len(IN) > 6 and IN[6] is not None else []
phases = IN[7] if len(IN) > 7 and IN[7] is not None else []

baseUrl = IN[8] if len(IN) > 8 and IN[8] is not None else "app.bimeye.com"
elements = IN[9] if len(IN) > 9 and IN[9] is not None else None

ctx = ssl.create_default_context()


def _request_json(method, url, payload=None):
    data = None
    headers = {
        "content-type": "application/json",
        "authorization": access_token,
        "accept": "application/json",
    }

    if payload is not None:
        data = json.dumps(payload).encode("utf-8")

    req = urllib.request.Request(url, data=data, method=method)
    for k, v in headers.items():
        req.add_header(k, v)

    try:
        with urllib.request.urlopen(req, context=ctx, timeout=60) as r:
            body = r.read().decode("utf-8", errors="replace")
            return json.loads(body)
    except urllib.error.HTTPError as e:
        body = e.read().decode("utf-8", errors="replace")
        raise Exception("HTTP {} {} {}".format(e.code, url, body))


def getParameters():
    url = "https://{}/services/bim/v1/project/{}/parameter".format(baseUrl, projectGuid)
    res = _request_json("GET", url)
    return res.get("result", [])


def getMasterParameterNames():
    url = (
        "https://{}/services/bim/v1/project/{}/parameter"
        "?search[typeId]={}&search[relation]=masterParameter"
    ).format(baseUrl, projectGuid, typeId)
    res = _request_json("GET", url)
    items = res.get("result", []) or []
    return [p.get("name") for p in items if isinstance(p, dict) and p.get("name")]


def getWorktableCount(payload):
    url = "https://{}/services/bim/v1/project/{}/worktable/count?search%5BtypeId%5D={}".format(
        baseUrl, projectGuid, typeId
    )
    res = _request_json("POST", url, payload)
    return int(res.get("result", {}).get("count", 0))


def getWorktablePage(payload, limit, skip):
    url = (
        "https://{}/services/bim/v1/project/{}/worktable"
        "?search%5BtypeId%5D={}&limit={}&skip={}"
    ).format(baseUrl, projectGuid, typeId, limit, skip)
    res = _request_json("POST", url, payload)
    return res.get("result", []) or []


payload = {
    "categories": categories,
    "models": models,
    "states": states,
    "levels": levels,
    "phases": phases,
}

parameters = getParameters()
param_lookup = {}
for p in parameters:
    if isinstance(p, dict) and "id" in p:
        param_lookup[p["id"]] = p

headers = getMasterParameterNames()
if 'GlobalId' not in headers:
    headers.append('GlobalId')
if 'MMI' not in headers:
    headers.append('MMI')

header_row = {h: None for h in headers}
header_lower_to_key = {str(k).lower(): k for k in header_row.keys()}

count = getWorktableCount(payload)
limit = 1000
skip = 0

rows = []
while skip < count:
    page = getWorktablePage(payload, limit, skip)
    for row in page:
        rowData = dict(header_row)
        props = row.get("property", []) if isinstance(row, dict) else []
        for prop in props:
            pid = prop.get("parameterId") if isinstance(prop, dict) else None
            if pid in param_lookup:
                name = param_lookup[pid].get("name")
                if name is None:
                    continue
                key = header_lower_to_key.get(str(name).lower())
                if key is not None:
                    rowData[key] = prop.get("value")
        rows.append(rowData)

    skip += limit
    if skip > count:
        skip = count


def _lookup_param(el, names):
    for n in names:
        try:
            p = el.LookupParameter(n)
        except Exception:
            p = None
        if p is not None:
            return p
    return None


mmi_by_globalid = {}
for r in rows:
    if not isinstance(r, dict):
        continue
    gid = r.get('GlobalId')
    if gid is None:
        continue
    mmi_by_globalid[str(gid)] = r.get('MMI')

update = {'attempted': 0, 'updated': 0, 'not_found': 0, 'missing_params': 0, 'errors': 0}
update_errors = []

if elements is not None:
    try:
        clr.AddReference('RevitServices')
        from RevitServices.Persistence import DocumentManager
        from RevitServices.Transactions import TransactionManager

        clr.AddReference('RevitAPI')
        from Autodesk.Revit.DB import StorageType

        try:
            clr.AddReference('RevitNodes')
            import Revit
            clr.ImportExtensions(Revit.Elements)
            unwrap = UnwrapElement
        except Exception:
            def unwrap(x):
                return x

        doc = DocumentManager.Instance.CurrentDBDocument
        els = elements
        if not isinstance(els, list):
            els = [els]

        TransactionManager.Instance.EnsureInTransaction(doc)
        for el in els:
            update['attempted'] += 1
            try:
                revit_el = unwrap(el)
                if revit_el is None:
                    update['errors'] += 1
                    update_errors.append('UnwrapElement returned None')
                    continue

                gid_param = _lookup_param(revit_el, ['GlobalId', 'GlobalID', 'IFC GUID', 'IfcGUID', 'Ifc Guid', 'IFC Guid'])
                mmi_param = _lookup_param(revit_el, ['MMI'])
                if gid_param is None or mmi_param is None:
                    update['missing_params'] += 1
                    continue

                gid_val = gid_param.AsString()
                if gid_val is None:
                    gid_val = gid_param.AsValueString()
                if not gid_val:
                    update['not_found'] += 1
                    continue

                if gid_val not in mmi_by_globalid:
                    update['not_found'] += 1
                    continue

                mmi_val = mmi_by_globalid[gid_val]
                st = mmi_param.StorageType
                if st == StorageType.String:
                    mmi_param.Set('' if mmi_val is None else str(mmi_val))
                elif st == StorageType.Double:
                    mmi_param.Set(0.0 if mmi_val is None or mmi_val == '' else float(mmi_val))
                elif st == StorageType.Integer:
                    mmi_param.Set(0 if mmi_val is None or mmi_val == '' else int(float(mmi_val)))
                else:
                    mmi_param.Set('' if mmi_val is None else str(mmi_val))

                update['updated'] += 1
            except Exception as e:
                update['errors'] += 1
                update_errors.append(str(e))

        TransactionManager.Instance.TransactionTaskDone()
    except Exception as e:
        update = {'attempted': 0, 'updated': 0, 'not_found': 0, 'missing_params': 0, 'errors': 1}
        update_errors = [str(e)]

table = [headers] + [[r.get(h) for h in headers] for r in rows]
meta = {'count': count, 'headers': len(headers), 'update': update, 'updateErrors': update_errors, 'mmiKeys': len(mmi_by_globalid)}
OUT = (rows, table, meta)
# ----------------------------------------
